# Grasshopper definition GH_E_Environmental_Dashboard_HUD.gh (Grasshopper 1.0.7)
# plug-ins: Human UI, Human, MetaHopper

panel = Panel("""Grasshopper
HumanUI
Human
Ladybug
Honeybee
Environmental Analysis""")
panel_2 = Panel("This Script allows you to analyize your site and buildings environmental conditions. ")
path = FilePath("C:\Users\nkelly\OneDrive - HMC Architects\Experimentation\GitHub\hmcarchitects.github.io\")
# DESIGNER'S
# GUIDELINES
# DESIGNER'S GUIDELINES
# 
# 1. DIVIDE THE GRASSHOPPER DEFINITION INTO THE USER INTERFACE AND THE BACK-END
# 
# 2. BUILD THE DEFINITION WITH SMALL BLOCKS
# 
# 3. BLOCKS SHOULD ALWAYS HAVE INPUT/OUTPUT
# 
# 4. RENAME INPUT/OUTPUT CONTAINERS TO DATA THEY CARRY
# 
# 5. COLOR-CODE BLOCKS ACCORDING TO THE TEMPLATE
exporthydra = Hydra_ExportFile(
    fileName="GH E Environmental Dashboard HUD",
    fileDescription=panel_2,
    fileTags=panel,
    targetFolder=path,
    includeRhino=Toggle(False),
    GHForThumb=Toggle(False),
    export=Button())  # -> readMe; inputs fileDescription: list, changeLog: list, fileTags: list, includeRhino: Boolean, GHForThumb: Boolean, additionalImgs: list, export: Boolean; plug-in component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
panel_3 = Panel(exporthydra)

panel_4 = Panel("Click to Open .EPW URL (Right Click Location to copy File URL)")
sun_path_text_scale = Slider(9.9, range=0..100)
analysis_resolution = Slider(2, range=0..10)
legend_scale = Slider(1, range=0..5)
legend_text_scale = Slider(2.5, range=0..50)
sun_path_scale = Slider(1, range=0..5)
hour_24hr = Slider(9, range=5..19)
sun_scale = Slider(0.5, range=0.1..1)
day = Slider(21, range=1..31)
month = Slider(12, range=1..12)
# HMC ARCHITECTS -
# DIGITAL PRACTICE
# PROJECT INFO
# <PROJECT NO.>
# <ENVIRONMENTAL
#   DASHBOARD>
# CREATED BY: Noah Kelly, Jake Chevrier
# CREATED: 2019/07/09
# OFFICE LOCATION: Sacramento/Ontario
# 
# VERSION 1.0C
# LAST EDITED: 2020/09/11
# 
# 
# PLUGINS:
# <PLUGINS>
# HumanUI, Version=0.8.1.2
# 
# NOTES:
# <NOTES>
panel_5 = Panel("Full Day")

ladybug = Ladybug_Ladybug()  # -> Vviiiiiiiiiizzz; plug-in component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

checklist = CreateChecklist(ChecklistItems=panel_5, Selected=False)
hour = CreateSlider(Slider=hour_24hr, SnapValue=0, ShowBounds=True, ShowTicks=True, ShowTooltip=False, ShowValLabel=True, showLabel=True)
checklist_2 = CreateChecklist(ChecklistItems="All Year", Selected=False)
month_2 = CreateSlider(Slider=month, ShowBounds=True, ShowTicks=True, ShowTooltip=False, ShowValLabel=True, showLabel=True)
day_2 = CreateSlider(Slider=day, ShowBounds=True, ShowTicks=True, ShowTooltip=False, ShowValLabel=True, showLabel=True)
month_3 = CreateSlider(Slider=analysis_resolution, ShowBounds=True, ShowTicks=True, ShowTooltip=False, ShowValLabel=True, showLabel=True)
month_4 = CreateSlider(Slider=sun_scale, ShowBounds=True, ShowTicks=True, ShowTooltip=False, ShowValLabel=True, showLabel=True)
month_5 = CreateSlider(Slider=sun_path_scale, ShowBounds=True, ShowTicks=True, ShowTooltip=False, ShowValLabel=True, showLabel=True)
month_6 = CreateSlider(Slider=legend_scale, ShowBounds=True, ShowTicks=True, ShowTooltip=False, ShowValLabel=True, showLabel=True)
month_7 = CreateSlider(Slider=legend_text_scale, ShowBounds=True, ShowTicks=True, ShowTooltip=False, ShowValLabel=True, showLabel=True)
month_8 = CreateSlider(Slider=sun_path_text_scale, ShowBounds=True, ShowTicks=True, ShowTooltip=False, ShowValLabel=True, showLabel=True)
textbox = CreateTextBox(Label="EPW File", DefaultText="Copy .EPW Link Here - click button to update --->", UpdateButton=True, showLabel=True)
button = CreateButton(ButtonName=panel_4, ButtonStyle=0)
values = ValueListener(Elements=checklist, SomeProperty=True)  # -> Values, Indices
values_2 = ValueListener(Elements=hour, SomeProperty=True)  # -> Values, Indices
values_3 = ValueListener(Elements=checklist_2, SomeProperty=True)  # -> Values, Indices
values_4 = ValueListener(Elements=month_2, SomeProperty=True)  # -> Values, Indices
values_5 = ValueListener(Elements=day_2, SomeProperty=True)  # -> Values, Indices
values_6 = ValueListener(Elements=month_3, SomeProperty=True)  # -> Values, Indices
values_7 = ValueListener(Elements=month_4, SomeProperty=True)  # -> Values, Indices
values_8 = ValueListener(Elements=month_5, SomeProperty=True)  # -> Values, Indices
values_9 = ValueListener(Elements=month_6, SomeProperty=True)  # -> Values, Indices
values_10 = ValueListener(Elements=month_7, SomeProperty=True)  # -> Values, Indices
values_11 = ValueListener(Elements=month_8, SomeProperty=True)  # -> Values, Indices
values_12 = ValueListener(Elements=textbox, SomeProperty=True)  # -> Values, Indices
values_13 = ValueListener(Elements=button, SomeProperty=True)  # -> Values, Indices
panel_6 = Panel(values_12.Values)
panel_7 = Panel(values.Values)
panel_8 = Panel(values_2.Values)
panel_9 = Panel(values_3.Values)
panel_10 = Panel(values_5.Values)
panel_11 = Panel(values_6.Values)
panel_12 = Panel(values_7.Values)
panel_13 = Panel(values_9.Values)
panel_14 = Panel(values_10.Values)
panel_15 = Panel(values_11.Values)
panel_16 = Panel(values_4.Values)
panel_17 = Panel(values_8.Values)
panel_18 = Panel(values_13.Values)

downloadepw = Ladybug_downloadEPWWeatherFile(download=values_13.Values)  # -> readMe; plug-in component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
wiretoggle = WireDisplayToggle(ShowHiddenWires=Toggle(True))

# ----
# All work is protected under the Creative Commons Attribution-Noncommercial-Share Alike 3.0 United States license
# 1. Set Geometry
model_geometry = Brep(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)

# ----
# USE:
# 
# FOR INCOMING REFERENCES SUCH AS FILEPATHS AND GEOMETRIES
# 2. Set to True and Use UI for Analysis
toggle = BooleanToggle(False)

# ---- group: Month
series = Series(Start=1, Step=1, Count=12)
gate = StreamGate(Stream=values_4.Values, Gate=values_3.Values)  # -> Target0, Target1
gate_2 = StreamGate(Stream=series, Gate=values_3.Values)  # -> Target0, Target1

# ---- group: Hour
series_2 = Series(Start=1, Step=1, Count=24)
gate_3 = StreamGate(Stream=values_2.Values, Gate=values.Values)  # -> Target0, Target1
gate_4 = StreamGate(Stream=series_2, Gate=values.Values)  # -> Target0, Target1

# ---- group: Day
gate_5 = StreamGate(Stream=values_5.Values, Gate=values_3.Values)  # -> Target0, Target1

# ----
epw_stat = Ladybug_OpenEPWAndSTATWeatherFiles(weatherFileURL=values_12.Values)  # -> epwFile, statFile; plug-in component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
importepw = Ladybug_ImportEpw(epwFile=epw_stat.epwFile)  # -> readMe, latitude, location, dryBulbTemperature, dewPointTemperature, relativeHumidity, windSpeed, windDirection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; plug-in component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
legendpar = Ladybug_LegendParameters(numSegments=10, legendScale=values_9.Values, fontSize=values_10.Values)  # -> legendPar; plug-in component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

# ---- group: Alternative DP Color Scheme
legendpar_2 = Ladybug_LegendParameters(
    customColors=flatten([ColourSwatch(SwatchColor=RGB(255, 150, 217)), ColourSwatch(SwatchColor=RGB(255, 50, 153)), ColourSwatch(SwatchColor=RGB(161, 26, 229)), ColourSwatch(SwatchColor=RGB(0, 64, 255)), ColourSwatch(SwatchColor=RGB(0, 25, 99))]),
    legendScale=values_9.Values,
    fontSize=values_10.Values,
    decimalPlaces="0")  # -> legendPar; plug-in component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

number_slider = Slider(0.88, range=0..2)
legendpar_3 = Ladybug_LegendParameters(customColors=flatten([ColourSwatch(SwatchColor=RGB(255, 150, 217)), ColourSwatch(SwatchColor=RGB(255, 50, 153)), ColourSwatch(SwatchColor=RGB(161, 26, 229)), ColourSwatch(SwatchColor=RGB(0, 64, 255)), ColourSwatch(SwatchColor=RGB(0, 25, 99))]))  # -> legendPar; plug-in component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

legendpar_4 = Ladybug_LegendParameters(
    customColors=flatten([ColourSwatch(SwatchColor=RGB(255, 150, 217)), ColourSwatch(SwatchColor=RGB(255, 50, 153)), ColourSwatch(SwatchColor=RGB(161, 26, 229)), ColourSwatch(SwatchColor=RGB(0, 64, 255)), ColourSwatch(SwatchColor=RGB(0, 25, 99))]),
    fontSize=Slider(0.88, range=0..2))  # -> legendPar; plug-in component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

# ---- group: DESIGN
# LEGEND
# UTILITY
# USE:
# 
# "WORK IN PROGRESS"
# USE:
# 
# FOR CANVAS/CABLE MANAGMENT
# USE:
# 
# FOR BLOCKS TO BAKE GEOMETRY
# USE:
# 
# FOR VIEWING TEXT/GEOMETRY IN THE RHINO VIEWPORT
# USE:
# 
# FOR THE USE OF INPUT, EG SLIDERS, NUMBERS, ETC.
panel_19 = Panel("""USE:

BACK-END FUNCTIONALITY""")

# ---- group: Create Analysis Periods for Each Month
analysisperiod = Ladybug_AnalysisPeriod(fromMonth=[gate.Target0, gate_2.Target1], fromDay=gate_5.Target0, fromHour=[gate_3.Target0, gate_4.Target1])  # -> readMe, simplify(analysisPeriod); plug-in component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

# ----
# RADIATION ROSE
toggle_2 = BooleanToggle(True)
gencumulativeskymtx = Ladybug_GenCumulativeSkyMtx(epwFile=epw_stat.epwFile, skyDensity=0, useOldRes=True, runIt=toggle_2)  # -> readMe, cumulativeSkyMtx; plug-in component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
selectskymtx = Ladybug_selectSkyMtx(cumulativeSkyMtx=gencumulativeskymtx.cumulativeSkyMtx, removeDiffuse=False, removeDirect=False)  # -> readMe, selectedSkyMtx; plug-in component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
toggle_3 = BooleanToggle(True)
radiationrose = Ladybug_RadiationRose(
    selectedSkyMtx=selectskymtx.selectedSkyMtx,
    scale=Slider(0.55, range=0..1),
    arrowHeadScale=1,
    legendPar=legendpar_3,
    showTotalOnly=toggle_3,
    runIt=toggle_3)  # -> readMe, radiationArrowsMesh, radRoseBaseCrvs, legend, legendBasePts, radRoseEndPts, radRoseValues; plug-in component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
range = Range(Domain=radiationrose.radRoseValues, Steps=10)

# ---- group: Sunlight Analysis
# SUN PATH DATA
c2f = Ladybug_C2F(C=importepw.dryBulbTemperature)  # -> F; plug-in component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
pt = Point(Point(2277.839007, 45.38843543, 0))
sunpath = Ladybug_SunPath(
    location=importepw.location,
    hour=12,
    day=21,
    month=12,
    timeStep=1,
    analysisPeriod=analysisperiod.analysisPeriod,
    centerPt=pt,
    sunPathScale=values_8.Values,
    sunScale=values_7.Values,
    legendPar=[legendpar_3, legendpar],
    dailyOrAnnualSunPath=True)  # -> readMe, sunVectors, sunAltitudes, sunAzimuths, port, sunSpheresMesh, sunPathCrvs, compassCrvs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; plug-in component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
panel_20 = Panel([sunpath.sunAltitudes, sunpath.sunAzimuths])
panel_21 = Panel("""Sun Altitudes 
Sun Azimuths """)
bnd = Bounds(Numbers=panel_20)
concat = Concatenate(FragmentA=panel_21, FragmentB=bnd)
panel_22 = Panel(concat)

srfsolar = Ladybug_SurfaceHourlySolar(
    location=importepw.location,
    directNormal=importepw.directNormalIlluminance,
    diffuseHorizontal=importepw.diffuseHorizontalIlluminance)  # -> readMe, srfDirect, srfDiffuse, srfTotal, srfDirection; plug-in component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
strnum = Ladybug_SeparateData(inputList=flatten(srfsolar.srfDirect))  # -> numbers, strings; plug-in component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
cull_i = CullIndex(List=strnum.numbers, Indices="0", Wrap=True)  # -> graft(List)
cull_i_2 = CullIndex(List=strnum.numbers, Indices="-1", Wrap=True)  # -> graft(List)
avr = Average(Input=[cull_i_2, cull_i])  # -> flatten(ArithmeticMean)
ins = InsertItems(List=avr, Item="0", Indices="-1", Wrap=True)
data = Data(flatten([strnum.strings, ins]))

daylight_threshold_lux = Panel("1000")
window_transmittance = Panel("0.6")

# ----
# PSYCHROMETRIC CHART
panel_23 = Panel("0.012")
strategylist = Ladybug_PassiveStrategyList({"Evaporative Cooling", "Thermal Mass + Night Vent", "Occupant Use of Fans", "Capture Internal Heat Gain": "Internal Heat Gain", "Passive Solar Heating", "Dessicant Dehumidification", "Dehumidification Only", "Humidification Only"}, selected=["Evaporative Cooling", "Thermal Mass + Night Vent", "Occupant Use of Fans", "Capture Internal Heat Gain", "Dessicant Dehumidification"])
pmvcomfortpar = Ladybug_PMVComfortParameters(humidRatioUpBound=panel_23)  # -> comfortPar; plug-in component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
panel_24 = Panel("""0.6
1""")
pt_2 = Point(<point referenced from the Rhino model>)
psychchart = Ladybug_PsychrometricChart(
    dryBulbTemperature=importepw.dryBulbTemperature,
    relativeHumidity=importepw.relativeHumidity,
    barometricPressure=importepw.barometricPressure,
    clothingLevel=panel_24,
    mergeComfPolygons=Toggle(True),
    comfortPar=pmvcomfortpar,
    passiveStrategy=strategylist,
    basePoint=pt_2,
    scale=Slider(33, range=0..100),
    legendPar=legendpar_3,
    runIt=Toggle(True))  # -> readMe, port, totalComfortPercent, totalComfortOrNot, strategyNames, strategyPercentOfTime, strategyOrNot, port_2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; plug-in component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
panel_25 = Panel(psychchart.strategyNames)
panel_26 = Panel(psychchart.totalComfortPercent)
panel_27 = Panel(psychchart.strategyPercentOfTime)
preview = CustomPreview(
    Geometry=[psychchart.chartCurvesAndTxt, psychchart.comfortPolygons, psychchart.strategyPolygons],
    Shader=ColourSwatch(SwatchColor=RGB(0, 0, 0)))
concat_2 = Concatenate(FragmentA=panel_25, FragmentB=panel_27)
number_slider_2 = Slider(0.22, range=0..1)
panel_28 = Panel("0.210")
pt_3 = Point(Point(-6148.598187, -1277.605684, 0))
_3dchart = Ladybug_3DChart(
    inputData=flatten(psychchart.strategyOrNot),
    basePoint=pt_3,
    xScale=number_slider_2,
    yScale=number_slider_2,
    zScale="0",
    legendPar=legendpar_3)  # -> readMe, graphMesh, graphCurves, legend, legendBasePts, title, titleBasePts, dataPts, conditionalHOY; plug-in component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

# ---- group: Sunlight Analysis
division = Division(A="1", B=window_transmittance)
multiplication = Multiplication(A=daylight_threshold_lux, B=division)
concat_3 = Concatenate(FragmentA="a>", FragmentB=multiplication)
conditional_statement = Panel(concat_3)

# ---- group: Single Wind Rose
toggle_4 = BooleanToggle(False)
pt_4 = Point(Point(-2459.565868, -62.24802956, 0))
windrose = Ladybug_WindRose(
    north=0,
    hourlyWindDirection=importepw.windDirection,
    hourlyWindSpeed=importepw.windSpeed,
    analysisPeriod=analysisperiod.analysisPeriod,
    centerPoint=pt_4,
    showFrequency=toggle_4,
    showAverageVelocity=toggle_4,
    scale=Slider(0.9, range=0..10),
    legendPar=legendpar_3,
    runIt=Toggle(True))  # -> readMe, calmRoseMesh, windRoseMesh, windRoseCrvs, windRoseCenPts, legend, legendBasePts, title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; plug-in component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
# WIND ANALYSIS
preview_2 = CustomPreview(
    Geometry=[windrose.windRoseMesh, windrose.windRoseCrvs, windrose.calmRoseMesh],
    Shader=ColourSwatch(SwatchColor=RGB(0, 0, 0)))

# ----
windspeedcalculator = Ladybug_WindSpeedCalculator(
    windSpeed_tenMeters=importepw.windSpeed,
    windDirection=importepw.windDirection,
    terrainType=Slider(0, range=0..3),
    heightAboveGround="1",
    analysisPeriod=analysisperiod.analysisPeriod)  # -> readMe, windSpeedAtHeight, windVectorAtHeight; plug-in component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

activitieslist = Ladybug_ActivitiesMetList({"Sleeping": 0.7, "Reclining": 0.8, "Sitting": 1.0, "Typing": 1.1, "Standing": 1.2, "Driving": 1.5, "Cooking": 1.8, "House Cleaning": 2.7, "Strolling": 1.7, "Walking 2mph": 2.0, "Walking 3mph": 2.6, "Walking 4mph": 3.8, "Running 9mph": 9.5, "Lifting 10lbs": 2.1, "Lifting 100lbs": 4.0, "Shoveling": 4.4, "Dancing": 3.4, "Basketball": 6.3}, selected="Walking 4mph")
pmvcomfortcalculator = Ladybug_PMVComfortCalculator(
    dryBulbTemperature=importepw.dryBulbTemperature,
    windSpeed=importepw.windSpeed,
    relativeHumidity=importepw.relativeHumidity,
    metabolicRate=activitieslist,
    analysisPeriod=analysisperiod.analysisPeriod,
    calcBalanceTemperature=False,
    runIt=Toggle(True))  # -> readMe, port, predictedMeanVote, percentPeopleDissatisfied, standardEffectiveTemperature, port_2, comfortableOrNot, percentOfTimeComfortable, port_3, balanceTemperature; plug-in component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

# ---- group: Sunlight Analysis
toggle_5 = BooleanToggle(True)
sunlighthoursanalysis = Ladybug_SunlightHoursAnalysis(
    geometry=flatten(model_geometry),
    gridSize=values_6.Values,
    disFromBase="0.001",
    sunVectors=flatten(sunpath.sunVectors),
    timeStep=1,
    legendPar=flatten(legendpar_3),
    parallel=toggle_5,
    runIt=toggle_5)  # -> readMe, contextMesh, analysisMesh, testPts, testVec, port, sunlightHoursResult, sunlightHoursMesh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; plug-in component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

# ----
# OUTDOOR COMFORT LEVEL
panel_29 = Panel(windspeedcalculator.windSpeedAtHeight)

number_slider_3 = Slider(0.38, range=0..1)
pt_5 = Point(Point(-3378.361721, -1702.72746, 0))
panel_30 = Panel(importepw.dryBulbTemperature)
_3dchart_2 = Ladybug_3DChart(
    inputData=flatten([importepw.dryBulbTemperature, importepw.dewPointTemperature, importepw.windSpeed]),
    basePoint=pt_5,
    xScale=number_slider_3,
    yScale=number_slider_3,
    zScale="0",
    legendPar=legendpar_4)  # -> readMe, graphMesh, graphCurves, legend, legendBasePts, title, titleBasePts, dataPts, conditionalHOY; plug-in component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

pt_6 = Point(Point(1907.72027, -2290.297756, 0))
_3dchart_3 = Ladybug_3DChart(
    inputData=flatten(pmvcomfortcalculator.standardEffectiveTemperature),
    basePoint=pt_6,
    xScale="2",
    yScale="2",
    zScale="0",
    legendPar=legendpar_3)  # -> readMe, graphMesh, graphCurves, legend, legendBasePts, title, titleBasePts, dataPts, conditionalHOY; plug-in component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

preview_3 = CustomPreview(
    Geometry=[radiationrose.radRoseBaseCrvs, sunpath.sunPathCrvs, sunpath.compassCrvs, _3dchart.graphCurves, _3dchart.legend],
    Shader=ColourSwatch(SwatchColor=RGB(0, 0, 0)))
previewlw = CustomPreviewLineweights(
    Geometry=[sunpath.sunPathCrvs, windrose.windRoseCrvs, _3dchart_2.graphCurves, sunpath.compassCrvs, _3dchart.graphCurves, _3dchart_3.graphCurves],
    Shader=ColourSwatch(SwatchColor=RGBA(0, 0, 0, 195)),
    Absolute=True)

panel_31 = Panel("Wind Direction (degrees) ")
panel_32 = Panel("Average Wind Velocity (m/s) ")
label = CreateLabel(LabelText=panel_32, LabelSize=12, Justification=0)
concat_4 = Concatenate(FragmentA=panel_32)
label_2 = CreateLabel(LabelText=panel_31, LabelSize=12, Justification=0)
concat_5 = Concatenate(FragmentA=panel_31)
setlabel = SetLabelContents(LabelToModify=label, NewLabelContents=concat_4)
setlabel_2 = SetLabelContents(LabelToModify=label_2, NewLabelContents=concat_5)

panel_33 = Panel("Total Comfort Percentage")
label_3 = CreateLabel(LabelText=graft(concat_2), LabelSize=12, Justification=0)  # -> flatten(Label)
setlabel_3 = SetLabelContents(LabelToModify=label_3, NewLabelContents=concat_2)
label_4 = CreateLabel(LabelText=panel_33, LabelSize=12, Justification=0)
concat_6 = Concatenate(FragmentA=panel_33)
setlabel_4 = SetLabelContents(LabelToModify=label_4, NewLabelContents=concat_6)

panel_34 = Panel("Annual Solar Raditation (kWh/m2) ")
label_5 = CreateLabel(LabelText="Sun Altitudes ", LabelSize=12, Justification=0)
concat_7 = Concatenate(FragmentA="Sun Altitudes ", FragmentB=[panel_20, sunpath.sunAltitudes])
label_6 = CreateLabel(LabelText="Sun Azimuths ", LabelSize=12, Justification=0)
concat_8 = Concatenate(FragmentA="Sun Azimuths ", FragmentB=[panel_20, sunpath.sunAltitudes, sunpath.sunAzimuths])
label_7 = CreateLabel(LabelText=panel_34, LabelSize=12, Justification=0)
concat_9 = Concatenate(FragmentA=panel_34, FragmentB=range)
setlabel_5 = SetLabelContents(LabelToModify=label_5, NewLabelContents=concat_7)
setlabel_6 = SetLabelContents(LabelToModify=label_6, NewLabelContents=concat_8)
setlabel_7 = SetLabelContents(LabelToModify=label_7, NewLabelContents=concat_9)

# ---- group: Thermal Comfort Pie Chart
panel_35 = Panel("Passive Strategy Results")
chart = CreateChart(Data=panel_27, Names=[panel_35, concat_2], Title=panel_35, ChartType=1)  # -> flatten(Chart)
chartappearance = ChartAppearance(ChartToModify=chart)

# ----
separator = CreateSeparator(Thickness=0.5, Horizontal=True, Color=RGB(0, 191, 255), Height=20)
browser = CreateBrowser(URL="https://www.ladybug.tools/epwmap/", Width=640, Height=320)
panel_36 = Panel("Search for your project location, copy the epw file to your clipboard, and then paste that into the EPW file location below. ")
panel_37 = Panel("Click the grey button to the right in order to load the EPW file")

load_epw_file = Merge(Data1=browser, Data2=separator, Data3=textbox)
gloabal_analysis_period = Merge(Data1=checklist, Data2=hour, Data3=checklist_2, Data4=month_2, Data6=day_2)
expander = CreateExpander(UIElements=load_epw_file, Header="Load .EPW File", Open=True)
expander_2 = CreateExpander(UIElements=gloabal_analysis_period, Header="Time Period and Day", Open=True)

merge = Merge(Data2=label, Data3=label_2)
expander_3 = CreateExpander(UIElements=merge, Header="Wind Analysis", Open=True)

project_metrics = Merge(Data1=label_4, Data2=chart)
expander_4 = CreateExpander(UIElements=project_metrics, Header="Project Metrics", Open=True)

tooltip = AttachTooltipToElement(ElementsToAttachTo=textbox, TooltipContent=panel_37, ShowDelay=10, Duration=4000)
tooltip_2 = AttachTooltipToElement(ElementsToAttachTo=expander, TooltipContent=panel_36, ShowDelay=10, Duration=6000)

# ----
# Add DP Assets
# to local C:Drive
path_2 = FilePath("C:\Users\nkelly\HMC Architects\Digital Practice - Documents\Graphics and Branding\DP Identity Graphics and Templates\DP Final Logos\DPlogo_SECONDARY1.png")

# ---- group: Plan Image Capture
panel_38 = Panel("Click to Refresh Diagram Results")
panel_39 = Panel("Environmental Analysis Diagrams")
getscreen = GetScreenDimensions()  # -> Width, Height
division_2 = Division(A=getscreen.Width, B=Slider(2, range=0..10))

# ----
range_2 = Range(Domain=sunlighthoursanalysis.totalSunlightHours, Steps=10)
label_8 = CreateLabel(LabelText="Annual Sunlight Hours ", LabelSize=12, Justification=0)

bnd_2 = Bounds(Numbers=range_2)
button_2 = CreateButton(ButtonName=panel_38, ButtonStyle=0)
values_14 = ValueListener(Elements=button_2, SomeProperty=True)  # -> Values, Indices
month_range = Relay()

panel_40 = Panel(bnd_2)
concat_10 = Concatenate(FragmentA="Annual Sunlight Hours ", FragmentB=bnd_2)
setlabel_8 = SetLabelContents(LabelToModify=label_8, NewLabelContents=concat_10)

# ---- group: Plan Image Capture (continued)
captureview = Ladybug_CaptureView(
    fileName=panel_39,
    folder="C:\Evironmental Dashboard",
    viewNames="Top",
    imageWidth=getscreen.Width,
    imageHeight=getscreen.Height,
    keepAspectR=values_14.Values,
    transparBack=values_14.Values,
    capture=values_14.Values)  # -> Output; plug-in component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
image = CreateImage(ImageSource=captureview, ImageWidth=division_2)
adjustpos = AdjustElementPositioning(ElementsToAdjust=image, AbsolutePositioning=True, VerticalAlignment=3)

# ----
project_metrics_2 = Merge(Data3=label_8, Data4=label_5, Data5=label_6, Data6=label_7)
sunlight_hours_settings = Merge(Data1=month_3, Data2=month_4, Data3=month_5, Data4=month_7, Data5=month_8)
expander_5 = CreateExpander(UIElements=sunlight_hours_settings, Header="Settings", Open=True)
expander_6 = CreateExpander(UIElements=project_metrics_2, Header="Sunlight Metrics", Open=True)

merge_2 = Merge(Data1=button_2, Data2=image)  # -> flatten(Result)
expander_7 = CreateExpander(UIElements=merge_2, Header=panel_39, Open=True)

# ---- group: HUD
launchwin = LaunchWindow(
    Show=toggle,
    Name="Environmental Analysis",
    Width="720",
    Height="550",
    ShowIcon=True,
    ChildStatus=1,
    EnableHorizScroll=True)
panel_41 = Panel("""Setup
Sunlight Analysis
Wind Analysis
Outdoor Comfort Statistics
Environmental Diagrams""")
tabs = TabbedView(
    TabNames=panel_41,
    TabTextSize="16",
    Tab0=flatten([expander, expander_2]),
    Tab1=flatten([expander_5, expander_6]),
    Tab2=flatten(expander_3),
    Tab3=flatten(expander_4),
    Tab4=flatten(expander_7))
addelems = AddElements(Window=launchwin, Elements=flatten(tabs), DoVLChecking=True)  # -> AddedElements, ElementNames
